# Dynamo graph MeshToSolid.dyn "MeshToSolidExample" (Dynamo 2.14.0.4641)
# packages: MeshToolkit 3.0.0

file_path = Filename(".\ZAG2020_test1164Manifold_filled.obj")

# group: Mesh to Solid
importFile = Autodesk.Dynamo.MeshToolkit.Mesh.ImportFile(fileName=file_path)
triangles = Autodesk.Dynamo.MeshToolkit.Mesh.Triangles(mesh=importFile)
byJoinedSurfaces = Solid.ByJoinedSurfaces(facesOfSolid=triangles)

volume = Solid.Volume(solid=byJoinedSurfaces)
volume_2 = Autodesk.Dynamo.MeshToolkit.Mesh.Volume(mesh=importFile)
